% Simulink data dictionary MtrCtrl_v01.sldd

K_slide = Simulink.Parameter(1, DataType="double")
SBase_W = 311769.1
SMOGain_V = 323.3162
LPF_coefg = 0.01
SecPerRnd = 0.6
B = 0.001889
F = 500
FBase_Hz = 200
F_pu = 2.5
Flux = 0.192
FluxBase_Vs = 0.4774648
Flux_pu = 0.4021239
IBase_A = 300
I_pu = 0.7333333
Id = 1
Iq = 1
Ireal = 220
J = 0.011
JBase_kgmm = 3.158882
Ki_pu = 0.04934802
Kis = 114583.3
Kp_pu = 6.267199
Kps = 57.29167
Kt = 1.152
LBase_H = 0.001591549
Ld = 0.000635
Lq = 0.000635
Ls = 0.000635
Ls_pu = 0.3989823
PBase_W = 311769.1
PU = 0.6844444
P_pu = 0.6844444
Pn = 35000
Pp = 4
Preal = 213388.7
RBase_Ohm = 2
Rs = 0.05
Rs_pu = 0.025
TqBase_Nm = 992.392
Ts = 0.0001
Ts_pu = 0.1256637
UBase_V = 600
U_pu = 0.9333333
Ud = 0.05
Udc = 560
Uq = 0.24327
Ureal = 560
ZBase_Ohm = 2
dt = 1
model = "ex_auto_gain_controller"
n = 3000
nBase_RPM = 3000
sud = "ex_auto_gain_controller/sud"
tBase_s = 0.0007957747
tol = 0.1
wBase_rps = 1256.637
we = 1
wmBase_rps = 314.1593
Kp = 0.9974557
Ki = 0.015